# Requirement set requirement set (R2022a)

## 1 [2.0] Movability
ส่วนการเคลื่อนที่

### 1.1 [2.1] มีการรับส่งข้อมูลเกี่ยวกับตำแหน่งของหุ่นยนต์
มีการรับส่งข้อมูลเกี่ยวกับตำแหน่งการเคลื่อนที่
Rationale: หุ่นยนต์ไปยังที่หมายได้ตามคำสั่ง

#### 1.1.1 [2.1.1] ความคลาดเคลื่อน
ตำแหน่งความคลาดเคลื่อนได้ไม่เกิน …… mm.
Rationale: อุปกรณ์ที่เลือกใช้จะได้ไม่แพงเกินไปแต่ยังทำงานได้

#### 1.1.2 [2.1.2] หุ่นยนต์สามารถรับรู้ตำแหน่งของตนเอง
มีการรับส่งข้อมูลตำแหน่งของตนเองกลับไปประมวลผลได้
Rationale: เพื่อช่วยพิจารณาคำสั่งต่อไปของหุ่นยนต์

### 1.2 [2.2] มีการรับส่งข้อมูลเกี่ยวกับความเร็วของหุ่นยนต์

#### 1.2.1 [2.2.1] ความเร็วที่หุ่นยนต์ทำได้
ความเร็วในการเคลื่อนที่สูงสุดของหุ่นยนต์ต้องไม่ต่ำกว่า …m/s
Rationale: เพื่อให้ทำงานที่กำหนดได้ทันเวลา และรู้ขอบเขตในการเลือกอุปกรณ์ขับเคลื่อน

### 1.3 [2.3] มีการรับส่งข้อมูลเกี่ยวกับความเร่งของหุ่นยนต์

#### 1.3.1 [2.3.1] ความเร่งที่หุ่นยนต์ทำได้
ความเร่งในการเคลื่อนที่สูงสุดของหุ่นยนต์ต้องไม่ต่ำกว่า …m/s^2
Rationale: เพื่อให้ทำงานที่กำหนดได้ทันเวลา และรู้ขอบเขตในการเลือกอุปกรณ์ขับเคลื่อน

## 2 [3.0] Manipulator
ส่วนของการยกของ

### 2.1 [3.1] แขนกลสามารถหยิบจับวัตถุที่สั่งได้

#### 2.1.1 [3.1.1] แขนกลสามารถตรวจสอบตำแหน่งที่วัตถุวางอยู่ได้
Rationale: แขนกลหยิบของไม่ผิดชิ้น

#### 2.1.2 [3.1.2] แขนกลสามารถตรวจสอบได้ว่าหยิบวัตถุสำเร็จแล้ว
แขนกลรับรู้ได้ว่าหยิบวัตถุที่สั่งได้แล้ว
Rationale: แขนกลรอทำงานหยิบของเสร็จก่อนโดยไม่โดนคำสั่งอื่นขัดหรือหยิบใหม่ถ้าหยิบพลาด